# Grasshopper definition RL_new_setup.gh (Grasshopper 1.0.7)
# plug-ins: Kangaroo2 Components, Anemone, Pufferfish

number_slider = Slider(100, range=0..100)  # disabled
panel = Panel("all covered/ test")  # disabled
panel_2 = Panel("225")  # disabled
subtraction = Subtraction(A=panel_2, B=number_slider)  # disabled
series = Series(Start=0, Step=1, Count=number_slider)  # disabled
series_2 = Series(Start=number_slider, Step=1, Count=subtraction)  # disabled

number_slider_2 = Slider(42, range=0..100)
button = Button()
number_slider_3 = Slider(0.7, range=0..1)
loop_start = LoopStart(N=Slider(100000, range=0..100000), T=button, D0=number_slider_2)  # -> port, Counter, Data, Data_2
loop_start_2 = LoopStart(Repeat=Slider(348, range=0..10000), Trigger=button, Data=number_slider_2)  # -> port, Counter, Data
agent = GhPythonScript(iter=loop_start.Counter)  # -> action, reset
# ---------- agent: Python ----------
__author__ = "boris"
__version__ = "2020.08.24"

import rhinoscriptsyntax as rs
import scriptcontext as sc

import socket
import struct
import pickle

class Connection:
    def __init__(self, s):
        self._socket = s
        self._buffer = ""

    def receive_object(self):
        while len(self._buffer) < 4 or len(self._buffer) < struct.unpack("<L", self._buffer[:4])[0] + 4:
            new_bytes = self._socket.recv(16)
            if len(new_bytes) == 0:
                return None
            self._buffer += new_bytes
        length = struct.unpack("<L", self._buffer[:4])[0]
        header, body = self._buffer[:4], self._buffer[4:length + 4]
        obj = pickle.loads(body)
        self._buffer = self._buffer[length + 4:]
        return obj

    def send_object(self, d):
        body = pickle.dumps(d)
        header = struct.pack("<L", len(body))
        msg = header + body
        self._socket.send(msg)


# Connection
if iter == 0:
    addr = ("127.0.0.1", 50710)
    agent_socket = socket.socket(socket.AF_INET, socket.SOCK_STREAM)
    agent_socket.connect(addr)
    agent_conn = Connection(agent_socket)
    # Reset
    msg_in = agent_conn.receive_object()
    if msg_in == "reset":
        reset = True
    else:
        raise RuntimeError("First message must be 'reset'")
else:
    # Send message
    msg_out = {"observation": sc.sticky["observation"],
               "reward": sc.sticky["reward"],
               "done": sc.sticky["done_inp"],
               "info": sc.sticky["info"]}
    agent_conn.send_object(msg_out)
    # Receive message
    msg_in = agent_conn.receive_object()
    if msg_in == "reset":
        reset = True
    elif msg_in == "close":
        reset = True
        agent_socket.close()
        #sc.sticky["enabled"] = False
    else:
        action = msg_in
# ---------- end agent ----------
dom = ConstructDomain(DomainStart=0, DomainEnd=Slider(100, range=0..100))
dom_2 = ConstructDomain(DomainStart=0, DomainEnd=Slider(20, range=0..100))

number_slider_4 = Slider(10, range=0..10)
number_slider_5 = Slider(15, range=0..100)
series_3 = Series(Start=0, Step=number_slider_4, Count=number_slider_5)
pt = ConstructPoint(XCoordinate=graft(series_3), YCoordinate=series_3, ZCoordinate=0)

dom_3 = ConstructDomain(DomainStart=number_slider_3, DomainEnd=Slider(0.8, range=0..1))
panel_3 = Panel(loop_start.Counter)
random = Random(Range=dom, Number=1, Seed=loop_start_2.Counter)
random_2 = Random(Range=dom_2, Number=1, Seed=loop_start_2.Counter)
random_3 = Random(Range=dom_3, Number=1, Seed=loop_start_2.Counter, Integers=False)
# Step 1: loop 1 to create playing field
panel_4 = Panel("1")
panel_5 = Panel("1")
roundd = RoundToDecimalPlace(NumberX=random_3, DecimalPlace=panel_4, RoundType=0)  # -> Rounded, Difference
int = Integer(random)
int_2 = Integer(random_2)
multiplication = Multiplication(A=number_slider_5, B=number_slider_5)
total_indices = Data(multiplication)
equals = Equality(FirstNumber=Toggle(True), SecondNumber=agent.reset)  # -> Equality, Inequality
addition = Addition(A=equals.Equality, B=loop_start.Data_2)
running = Running(
    port=loop_start.port,
    Exit=False,
    Data=loop_start.Data,
    Data_2=addition,
    TimeOutVal=0,
    pausedState=False,
    state="Constant output")  # -> D0, D1
multiplication_2 = Multiplication(A=number_slider_3, B=total_indices)
roundd_2 = RoundToDecimalPlace(NumberX=multiplication_2, DecimalPlace="0", RoundType=panel_4)  # -> Rounded, Difference
subtraction_2 = Subtraction(A=total_indices, B=roundd_2.Rounded)

# ----
# states : dead, res or green : 0, 1, 2
number_slider_6 = Slider(0.5, range=0..1)
multiplication_3 = Multiplication(A=number_slider_4, B=Slider(0.49, range=0..1))
circle = CircleCNR(Center=pt, Normal=Vector(0, 0, 1), Radius=multiplication_3)

# ----
# do it as a packing algorithim problem, where you predefine how many elements need to be packed and then the algorithim decides where to put them
number_slider_7 = Slider(0.5, range=0..1)
multiplication_4 = Multiplication(A=number_slider_4, B=Slider(0.15, range=0..1))
circle_2 = CircleCNR(Center=pt, Normal=Vector(0, 0, 1), Radius=multiplication_4)
pt_2 = ConstructPoint(XCoordinate=Slider(161, range=0..1000), YCoordinate=0, ZCoordinate=0)
pt_3 = ConstructPoint(XCoordinate=Slider(252, range=0..1000), YCoordinate=0, ZCoordinate=0)
panel_6 = Panel("green_Small")
panel_7 = Panel("res_small")
panel_8 = Panel("item_index")
item = ListItem(List=flatten(pt), Index=0, Wrap=True)  # disabled
panel_9 = Panel("merged")
panel_10 = Panel("state of neighbours")
panel_11 = Panel("observation")
panel_12 = Panel("if all done")
panel_13 = Panel("action")
panel_14 = Panel("1,2")
panel_15 = Panel("reset")
number_slider_8 = Slider(5, range=0..10)
panel_16 = Panel("Step 3 : Conditions")
grid_dimensions = Integer(number_slider_5)
# GO THROUGH ALL DEAD ITEMS THEN EXIT LOOP
points = Data(pt)
swatch = ColourSwatch(SwatchColor=RGB(0, 255, 36))
panel_17 = Panel(agent.action)
int_3 = Integer(panel_17)
panel_18 = Panel("calculating longest distance")
neg = Negative(Value="1")
neg_2 = Negative(Value="1")
panel_19 = Panel("average distance total")
item_2 = ListItem(List=flatten(pt), Index=0, Wrap=True)
item_3 = ListItem(List=flatten(pt), Index=neg_2, Wrap=True)
cluster = Cluster_7(total_indices=multiplication, B=number_slider_3)  # -> number_of_useable_green_2, a
panel_20 = Panel("all done conition")
dist = Distance(PointA=item_2, PointB=item_3)
panel_21 = Panel("observation_space")
ratio_chosen = Data(number_slider_3)
total_indices_2 = Data(total_indices)
dom_4 = ConstructDomain(DomainStart=0, DomainEnd=dist)
# ratio of useable left
number_of_useable_residential = Integer(flatten(cluster.a))
# ratio of usable green, ratio of usable res
panel_22 = Panel("1")
panel_23 = Panel("total area covered")
number_of_useable_green = Integer(flatten(cluster.number_of_useable_green_2))
number_of_useable_green_2 = Integer(flatten(cluster.number_of_useable_green_2))
number_of_useable_green_3 = Integer(flatten(cluster.a))
subtraction_3 = Subtraction(A=panel_22, B=number_slider_3)
ratio_of_useable_green = Data(subtraction_3)
ratio_of_useable_res = Data(number_slider_3)
panel_24 = Panel("reset condition 1.1")
total_indices_3 = Data(total_indices)
panel_25 = Panel(ratio_of_useable_res)
panel_26 = Panel(ratio_of_useable_green)
panel_27 = Panel("all done")
panel_28 = Panel("1")  # disabled
panel_30 = Panel("reset itteration")
# Reset
# 
# If you run out of items for distribution before the end of simulation reset
# 
# If the whole simulation is complete reset
# Observation Space
# 
# = ratio of green #done
# = ratio of res #done
# = ratio asked for #done
# = ratio of used left
# = ratio of used / useable
# = ratio of used i / total
# = ratio of useable
# = state of all neighbours
# = average distance total
# = average distance in that particular neighbourhood
# Reward
# 
# Changing state to green or res + 1
# 
# Calculate ratio of environment covered. The lesser the environment covered the higher the punishment, the greater the environment covered the higher the reward
# 
# reward if immediate neighbourhood distance minimised
# 
# highest reward if average distance for all  minimised
# the closer you are to the desired ratio the higher the reward the further from the desired ratio the higher the punishment - parabola
# 
# The more table you complete the higher the reward
# 
# the better overall connectivity to green spaces the better, based on situation of course
panel_31 = Panel("reward")
panel_32 = Panel("Total area Covered")
number_slider_9 = Slider(35, range=0..100)  # disabled
panel_33 = Panel("}")  # disabled
panel_34 = Panel("{")  # disabled
panel_35 = Panel("Reward")
number_slider_10 = Slider(7, range=0..10)  # disabled
panel_36 = Panel("Observation_space")
panel_37 = Panel("Reset")

# ----
# Generate random res and green space, Small
number_slider_11 = Slider(83, range=0..100)
dom_5 = ConstructDomain(DomainStart="0", DomainEnd=total_indices)
jitter = Jitter(List=pt, Jitter=1, Seed=loop_start_2.Data)  # -> Values, Indices
random_4 = Random(Range=dom_5, Number=Slider(10, range=0..10), Seed=2)
item_4 = ListItem(List=jitter.Values, Index=random_4, Wrap=True)
jitter_2 = Jitter(List=flatten(item_4), Jitter=1, Seed=loop_start_2.Data)  # -> Values, Indices
item_5 = ListItem(List=jitter_2.Values, Index=random_4, Wrap=True)
duppt = RemoveDuplicatePts(Points=item_5, Tolerance=0.01)
jitter_3 = Jitter(List=duppt, Jitter=1, Seed=number_slider_11)  # -> Values, Indices

lng = ListLength(List=jitter_3.Values)
multiplication_5 = Multiplication(A=lng, B=number_slider_7)

split = SplitList(List=jitter_3.Values, Index=multiplication_5)  # -> ListA, ListB
circle_3 = CircleCNR(Center=split.ListA, Normal=Vector(0, 0, 1), Radius=multiplication_3)
circle_4 = CircleCNR(Center=split.ListB, Normal=Vector(0, 0, 1), Radius=multiplication_3)

incurves = PointInCurves(Point=pt, Curves=circle_3)  # -> Relationship, Index, Point
incurves_2 = PointInCurves(Point=pt, Curves=circle_4)  # -> Relationship, Index, Point

cluster_2 = Cluster_4(bool=incurves_2.Relationship)  # -> item, data_3, data_4
cluster_3 = Cluster_4(bool=incurves.Relationship)  # -> item, data_3, data_4

cluster_4 = Cluster_5(d1=cluster_3.item, d2=cluster_2.item)

small_green = Integer(cluster_3.item)
small_res = Integer(cluster_2.item)

small_green_2 = Data(small_green)
# To check which item is beingn processed
# 
# Distance to alive, multiplied by item number
# 
# sort index based on this
# everytime the green and res run out before the whole board is full the reward goes to zero and the board is reset
# it calculates minimum distances of residential units in that neighbourhood, the lesser the distance the higher the reward, the reward for minimum distances is given based on that items distance to green space, if that item is close high score if that item is far negative score
# 
# the more area it fills the higher the reward (filling the area up is prioritised) +1 for each item it fills, the more items left on the table the higher the punshiment at the end of game
# Obsercation space: is aware of how many greens it has and how many res it can distribute and how many dead items left on the table, that it can distribute, is aware of average distance to green space for that neighbourhood, is aware of all the states of that neighbourhood
small_res_2 = Data(small_res)
loop_start_3 = LoopStart(N=Slider(100, range=0..100), T=loop_start_2.Counter, D0=small_green_2, D1=small_res_2)  # -> port, Counter, flatten(Data), flatten(Data_2)

counter = Data(loop_start_3.Counter)
small_green_3 = Data(loop_start_3.Data)
small_res_3 = Data(loop_start_3.Data_2)

points_2 = Data(pt)
small_res_4 = Data(small_res_3)
grid_dimensions_2 = Integer(number_slider_5)
small_green_4 = Data(small_green_3)

panel_38 = Panel(small_green_4)
# Loop 2 to go through all dead items and decide if they should be green or res
python = GhPythonScript(x=points_2, y=grid_dimensions_2, green_index=small_green_4, res_index=small_res_4)  # -> out, neighbour_index, flatten(item), dead_neighbour; inputs x: tree, green_index: list, res_index: list
# ---------- python: Python ----------
__author__ = "muham"
__version__ = "2023.04.22"

import rhinoscriptsyntax as rs


#Turn every cell into dictionary of information

index = 0
indexx = 0
iBp = []
lodN = {}
tp = y*y

for i in range(y):
    for u in range(y):
        if indexx in green_index or indexx in res_index:
            iBp.append({
                "index": indexx,  # index in flattened list
                "neighbour_refference": [[i - 1, u], [i - 1, u + 1], [i, u + 1], [i + 1, u + 1], [i + 1, u], [i + 1, u - 1], [i, u - 1], [i - 1, u - 1]],
                "neighbour_index": [],
                "dead_neighbour": [],
            })
        indexx +=1

#print(iBp[3])
#Find neighbour index


for i in iBp:
    neighbour_index = []
    dead_neighbour = []
    for _ in range(len(i["neighbour_refference"])):
        nR = i["neighbour_refference"]
        nI = (((nR[_][0]*y) % tp) + (nR[_][1] % tp))%tp
        if nI < 0:
            nI = tp + nI
        if nI not in green_index and nI not in res_index:
            d_n = nI
            dead_neighbour.append(d_n)
        neighbour_index.append(nI)
    i["neighbour_index"] = neighbour_index
    i["dead_neighbour"] = dead_neighbour

#print(iBp[13])

#Output
neighbour_index = []
item = []
dead_neighbour = []
for i in iBp:
    neighbour_index.append(i["neighbour_index"])
    item.append(i["index"])
    dead_neighbour.append(i["dead_neighbour"])
# ---------- end python ----------
ni = CSharpScript(x=python.neighbour_index)  # -> out, simplify(A)
# ---------- ni: C# ----------
    A = x;
# ---------- end ni ----------
# Loop 3 to go through all dead items and decide if they should be green or res
ni_2 = CSharpScript(x=python.dead_neighbour)  # -> out, simplify(A); same code as ni
tree_of_dead_neighbours = Data(flatten(ni_2.A))
# Step 1: loop 2 to find dead neighbours
python_2 = GhPythonScript(x=tree_of_dead_neighbours)  # -> out, a; inputs x: list
# ---------- python_2: Python ----------
__author__ = "muham"
__version__ = "2023.05.02"

import rhinoscriptsyntax as rs


lOdN = []
for i in x:
    if i not in lOdN:
        lOdN.append(i)

a = lOdN
# ---------- end python_2 ----------
sort = SortList(Keys=python_2.a)  # -> Keys, ValuesA
python_3 = GhPythonScript(x=small_green_3, y=small_res_3)  # -> out, clean_g, clean_r; inputs x: list, y: list
# ---------- python_3: Python ----------
__author__ = "muham"
__version__ = "2023.05.03"

import rhinoscriptsyntax as rs

clean_g = []
clean_r = []
for i in x:
    if i not in clean_g:
        clean_g.append(i)

for i in y:
    if i not in clean_r:
        clean_r.append(i)
# ---------- end python_3 ----------
list_of_dead_neighbours = Data(flatten(sort.Keys))
merged = Integer(cluster_4)
small_green_5 = Data(python_3.clean_g)
lng_2 = ListLength(List=list_of_dead_neighbours)
small_res_5 = Data(python_3.clean_r)
loop_start_4 = LoopStart(N=lng_2, T=counter, D0=flatten(small_green_5), D1=flatten(small_res_5))  # -> port, Counter, flatten(Data), flatten(Data_2)
data = Data(list_of_dead_neighbours)

small_green_6 = Data(loop_start_4.Data)
small_res_6 = Data(loop_start_4.Data_2)

small_green_7 = Data(small_green_6)
small_res_7 = Data(small_res_6)
item_6 = ListItem(List=list_of_dead_neighbours, Index=loop_start_4.Counter, Wrap=True)
panel_39 = Panel(small_green_6)
item_being_processed = Data(flatten(item_6))
python_4 = GhPythonScript(x=points, y=grid_dimensions, green_index=small_green_7, res_index=small_res_7, item_being_processed=item_being_processed)  # -> out, flatten(neighbour_index), flatten(neighbour_states); inputs x: tree, green_index: list, res_index: list
# ---------- python_4: Python ----------
__author__ = "muham"
__version__ = "2023.04.22"

import rhinoscriptsyntax as rs


#Turn every cell into dictionary of information

index = 0
indexx = 0
iBp = {}
lodN = {}
tp = y*y

for i in range(y):
    for u in range(y):
        if indexx == item_being_processed:
            iBp = {
                "index": indexx,  # index in flattened list
                "neighbour_refference": [[i - 1, u], [i - 1, u + 1], [i, u + 1], [i + 1, u + 1], [i + 1, u], [i + 1, u - 1], [i, u - 1], [i - 1, u - 1]],
                "neighbour_index": [],
                "neighbour_states": []
            }
        indexx +=1


#Find neighbour index

neighbour_index = []
for _ in range(len(iBp["neighbour_refference"])):
    nR = iBp["neighbour_refference"]
    nI = (((nR[_][0]*y) % tp) + (nR[_][1] % tp))%tp
    if nI < 0:
        nI = tp + nI
    neighbour_index.append(nI)
iBp["neighbour_index"] = neighbour_index

#Neighbours Dictionary


state = []
for u in iBp["neighbour_index"]:
    branch = int(u/y) % tp
    item = u%y
    if u in green_index:
        N_state = 2
    elif u in res_index:
        N_state = 1
    else:
        N_state = 0  # if in green_index, 2, elif in res_index, 1, else, 0
    state.append(N_state)

iBp_N = {
            "state": state,  # if in green_index, 2, elif in res_index, 1, else, 0
}

#Output



neighbour_index = iBp["neighbour_index"]
neighbour_states = iBp_N["state"]
# ---------- end python_4 ----------
neighbour_states = Data(python_4.neighbour_states)

panel_40 = Panel("1")  # disabled
panel_41 = Panel("0")  # disabled
equals_2 = Equality(FirstNumber=neighbour_states, SecondNumber=panel_40)  # -> Equality, Inequality; disabled
toggle = BooleanToggle(True)  # disabled
equals_3 = Equality(FirstNumber=neighbour_states, SecondNumber=panel_41)  # -> Equality, Inequality; disabled
toggle_2 = BooleanToggle(True)  # disabled
mindex = MemberIndex(Set=equals_2.Equality, Member=toggle)  # -> Index, Count; disabled
number_slider_12 = Slider(4, range=0..10)  # disabled
number_slider_13 = Slider(6, range=0..10)  # disabled
mindex_2 = MemberIndex(Set=equals_3.Equality, Member=toggle_2)  # -> Index, Count; disabled
larger = LargerThan(FirstNumber=mindex_2.Count, SecondNumber=number_slider_12)  # -> LargerThan, OrEqualTo; disabled
smaller = SmallerThan(FirstNumber=mindex.Count, SecondNumber=number_slider_13)  # -> SmallerThan, OrEqualTo; disabled
panel_42 = Panel("res")  # disabled

condition_1 = Data(larger.OrEqualTo)  # disabled
condition_2 = Data(smaller.OrEqualTo)  # disabled
and = GateAnd(A=condition_1, B=condition_2)  # disabled

greenorres = Data(and)  # disabled

small_green_8 = Data(small_green_6)
small_res_8 = Data(small_res_6)

python_5 = GhPythonScript(small_green=small_green_8, small_res=small_res_8, item=item_being_processed, condition=int_3)  # -> out, flatten(small_green), flatten(small_res), i_b_p; inputs small_green: list, small_res: list
# ---------- python_5: Python ----------
__author__ = "muham"
__version__ = "2023.04.26"

import rhinoscriptsyntax as rs

print(condition)

if condition == 0:
    small_res.append(item)

elif condition == 1:
    small_green.append(item)

i_b_p = item
# ---------- end python_5 ----------
item_7 = ListItem(List=list_of_dead_neighbours, Index=neg, Wrap=True)
neighbour_index = Data(python_4.neighbour_index)
equals_4 = Equality(FirstNumber=python_5.i_b_p, SecondNumber=item_7)  # -> Equality, Inequality
python_6 = GhPythonScript(x=equals_4.Equality)  # -> out, a
# ---------- python_6: Python ----------
__author__ = "muham"
__version__ = "2023.05.03"

import rhinoscriptsyntax as rs

if x == True or x == None:
    a = True
else:
    a = False
# ---------- end python_6 ----------
panel_44 = Panel(python_6.a)
neighbour_states_2 = Data(neighbour_states)
small_green_9 = Data(flatten(python_5.small_green))
cluster_5 = Cluster_6(points=pt, i=small_green_9, i_2=neighbour_index)
small_res_9 = Data(flatten(python_5.small_res))
cluster_6 = Cluster_6(points=pt, i=small_green_9, i_2=small_res_9)
cluster_7 = Cluster_6(points=pt, i=small_green_9, i_2=small_res_9)
lng_3 = ListLength(List=small_green_9)
lng_4 = ListLength(List=small_res_9)

small_green_10 = Data(flatten(python_5.small_green))
small_res_10 = Data(flatten(python_5.small_res))

lng_5 = ListLength(List=small_green_10)
lng_6 = ListLength(List=small_res_10)
subtraction_4 = Subtraction(A=roundd_2.Rounded, B=lng_6)
subtraction_5 = Subtraction(A=subtraction_2, B=lng_5)
series_4 = Series(Start=0, Step=Slider(7, range=0..10), Count=subtraction_4)
Y = UnitY(Factor=series_4)
series_5 = Series(Start=0, Step=Slider(7, range=0..10), Count=subtraction_5)
Y_2 = UnitY(Factor=series_5)
move = Move(Geometry=pt_2, Motion=Y)  # -> Geometry, Transform
move_2 = Move(Geometry=pt_3, Motion=Y_2)  # -> Geometry, Transform
lng_7 = ListLength(List=move.Geometry)
partition = PartitionList(List=move.Geometry, Size="20")
division = Division(A=lng_7, B="20")
lng_8 = ListLength(List=move_2.Geometry)
partition_2 = PartitionList(List=move_2.Geometry, Size="20")
division_2 = Division(A=lng_8, B="20")
round = Round(Number=division)  # -> Nearest, Floor, Ceiling
lng_9 = ListLength(List=partition)  # -> graft(Length)
round_2 = Round(Number=division_2)  # -> Nearest, Floor, Ceiling
lng_10 = ListLength(List=partition_2)  # -> graft(Length)
series_6 = Series(Start=0, Step=1, Count=round.Ceiling)
series_7 = Series(Start=0, Step=1, Count=round_2.Ceiling)
multiplication_6 = Multiplication(A=series_6, B=Slider(10, range=0..10))
repeat = RepeatData(Data=graft(multiplication_6), Length=lng_9)
X = UnitX(Factor=repeat)
move_3 = Move(Geometry=partition, Motion=X)  # -> Geometry, Transform
lng_11 = ListLength(List=repeat)
multiplication_7 = Multiplication(A=series_7, B=Slider(10, range=0..10))
repeat_2 = RepeatData(Data=graft(multiplication_7), Length=lng_10)
X_2 = UnitX(Factor=repeat_2)
move_4 = Move(Geometry=partition_2, Motion=X_2)  # -> Geometry, Transform
lng_12 = ListLength(List=repeat_2)
data_2 = Data(small_green_10)
data_3 = Data(small_res_10)
series_8 = Series(Start=0, Step="20", Count=round.Ceiling)
repeat_3 = RepeatData(Data=graft(series_8), Length=lng_9)
series_9 = Series(Start=0, Step="20", Count=round_2.Ceiling)
repeat_4 = RepeatData(Data=graft(series_9), Length=lng_10)
merge = Merge(Data1=data_2, Data2=data_3)
multiplication_8 = Multiplication(A=Slider(7, range=0..10), B=repeat_3)
Y_3 = UnitY(Factor=multiplication_8)
neg_3 = Negative(Value=Y_3)
move_5 = Move(Geometry=simplify(move_3.Geometry), Motion=simplify(neg_3))  # -> Geometry, Transform
multiplication_9 = Multiplication(A=Slider(7, range=0..10), B=repeat_4)
Y_4 = UnitY(Factor=multiplication_9)
neg_4 = Negative(Value=Y_4)
move_6 = Move(Geometry=simplify(move_4.Geometry), Motion=simplify(neg_4))  # -> Geometry, Transform
python_7 = GhPythonScript(x=data, y=merge)  # -> out, a; inputs x: list, y: list
# ---------- python_7: Python ----------
__author__ = "muham"
__version__ = "2023.05.04"

import rhinoscriptsyntax as rs

a = []
for i in x:
    if i not in y:
        a.append(i)
# ---------- end python_7 ----------
cull_i = CullIndex(List=flatten(pt), Indices=[python_7.a, data_2, data_3], Wrap=True)
preview = CustomPreview(Geometry=cull_i, Material=ColourSwatch(SwatchColor=RGB(255, 255, 0)))

circles = Data(circle)
item_8 = ListItem(List=flatten(circles), Index=data_3, Wrap=True)
item_9 = ListItem(List=flatten(circles), Index=data_2, Wrap=True)
preview_2 = CustomPreview(Geometry=item_9, Material=swatch)
preview_3 = CustomPreview(Geometry=item_8, Material=ColourSwatch(SwatchColor=RGB(255, 0, 0)))

cir = Circle(Plane=move_5.Geometry, Radius=Slider(3, range=0..10))
item_10 = ListItem(List=flatten(circle_2), Index=python_7.a, Wrap=True)
cir_2 = Circle(Plane=move_6.Geometry, Radius=Slider(3, range=0..10))
preview_4 = CustomPreview(Geometry=cir, Material=ColourSwatch(SwatchColor=RGB(255, 0, 0)))
preview_5 = CustomPreview(Geometry=cir_2, Material=swatch)
tag = TextTag3D(Location=item_8, Text="//", Size=number_slider_8, Justification=7)
tag_2 = TextTag3D(Location=item_9, Text="#", Size=number_slider_8, Justification=7)
preview_6 = CustomPreview(Geometry=item_10, Material=ColourSwatch(SwatchColor=RGB(185, 205, 255)))
average_distances_for_neighbours = Data(flatten(cluster_5))
lng_13 = ListLength(List=small_green_9)
lng_14 = ListLength(List=small_res_9)
average_distances_for_all = Data(flatten(cluster_6))
number_of_used_residential = Integer(flatten(lng_4))
# ratio of green, ratio of res used, on the board
cluster_8 = Cluster_8(B=total_indices_2, L=small_green_9, L_2=small_res_9, ratio_chosen=ratio_chosen)  # -> R, R_2, ratio_chosen_2
# ratio of used, ratio of used res
number_of_used_green = Integer(flatten(lng_3))
addition_2 = Addition(A=lng_13, B=lng_14)
subtraction_6 = Subtraction(A=number_of_useable_green, B=number_of_used_green)
subtraction_7 = Subtraction(A=number_of_useable_residential, B=number_of_used_residential)
division_3 = Division(A=addition_2, B=total_indices_2)
panel_45 = Panel(average_distances_for_all)
panel_46 = Panel(average_distances_for_neighbours)
running_2 = Running(
    port=loop_start_4.port,
    Exit=python_6.a,
    Data=small_green_10,
    Data_2=small_res_10,
    TimeOutVal=0,
    pausedState=False,
    state="Constant output")  # -> D0, D1
ratio_of_green = Data(cluster_8.R)
ratio_chosen_2 = Data(cluster_8.ratio_chosen_2)
ratio_of_res = Data(cluster_8.R_2)
division_4 = Division(A=number_of_used_green, B=number_of_useable_green)
division_5 = Division(A=number_of_used_residential, B=number_of_useable_residential)
division_6 = Division(A=subtraction_6, B=number_of_useable_green_2)
division_7 = Division(A=subtraction_7, B=number_of_useable_green_3)
division_8 = Division(A=neighbour_states_2, B="2")
merge_2 = Merge(Data1=small_green_10, Data2=small_res_10)
remap = RemapNumbers(Value=panel_45, Source=dom_4, Target=Domain(0, 1))  # -> Mapped, Clipped
remap_2 = RemapNumbers(Value=panel_46, Source=dom_4, Target=Domain(0, 1))  # -> Mapped, Clipped
python_8 = GhPythonScript(x=python_6.a, y=running_2.D0, z=running_2.D1)  # -> out, a, b
# ---------- python_8: Python ----------
__author__ = "muham"
__version__ = "2023.05.01"

import rhinoscriptsyntax as rs

if x == False:
    a = "" + int(1)
    b = "" + int(1)
else:
    a = y
    b = z
# ---------- end python_8 ----------
lng_15 = ListLength(List=merge_2)
panel_47 = Panel(division_3)
panel_48 = Panel(ratio_of_green)
panel_49 = Panel(ratio_of_res)
panel_50 = Panel(ratio_chosen_2)
panel_51 = Panel(division_4)
panel_52 = Panel(division_5)
panel_53 = Panel(division_6)
panel_54 = Panel(division_7)
panel_55 = Panel(remap.Mapped)
panel_56 = Panel(remap_2.Mapped)
larger_2 = LargerThan(FirstNumber=lng_15, SecondNumber=total_indices_3)  # -> LargerThan, OrEqualTo
# reset condition 1.2
# 
# go up to find 1.1
larger_3 = LargerThan(FirstNumber=lng_3, SecondNumber=cluster.number_of_useable_green_2)  # -> LargerThan, OrEqualTo
larger_4 = LargerThan(FirstNumber=lng_4, SecondNumber=cluster.a)  # -> LargerThan, OrEqualTo
or = GateOr(A=larger_3.LargerThan, B=larger_4.LargerThan)
or_2 = GateOr(A=larger_2.OrEqualTo, B=or)
running_3 = Running(
    port=loop_start_3.port,
    Exit=or_2,
    Data=python_8.a,
    Data_2=python_8.b,
    TimeOutVal=0,
    pausedState=False,
    state="Constant output")  # -> D0, D1
python_9 = GhPythonScript(x=or_2, y=int)  # -> out, a
# ---------- python_9: Python ----------
__author__ = "muham"
__version__ = "2023.05.01"

import rhinoscriptsyntax as rs

print(y)
if x == False:
    a = "" + int(1)
else:
    a = y
# ---------- end python_9 ----------
running_4 = Running(port=loop_start_2.port, Exit=False, Data=python_9.a, TimeOutVal=0, pausedState=False, state="Constant output")
subtraction_8 = Subtraction(A=panel_28, B=panel_56)  # disabled
panel_57 = Panel(subtraction_8)  # disabled
merge_3 = Merge(
    Data1=panel_47,
    Data2=panel_48,
    Data3=panel_49,
    Data4=panel_26,
    Data5=panel_25,
    Data6=panel_51,
    Data7=panel_52,
    Data8=panel_53,
    Data9=panel_54,
    Data10=panel_55)  # -> flatten(Result)
panel_58 = Panel(or_2)
python_10 = GhPythonScript(x=merge_3)  # -> out, a; inputs x: list
# ---------- python_10: Python ----------
__author__ = "muham"
__version__ = "2023.05.03"

import rhinoscriptsyntax as rs

a=[]
for i in x:
    if i >= 1:
        i = 1
    elif i <= 0:
        i = 0
    else:
        i = i
    a.append(i)
# ---------- end python_10 ----------
addition_3 = Addition(A=panel_51, B=panel_52)
subtraction_9 = Subtraction(A="1", B=panel_55)
multiplication_10 = Multiplication(A=addition_3, B=Slider(0.8, range=0..1))
addition_4 = Addition(A=panel_53, B=panel_54)
panel_59 = Panel(multiplication_10)
panel_60 = Panel(addition_4)
panel_61 = Panel(panel_47)
# Reward for reducing average distance
panel_62 = Panel(subtraction_9)
addition_5 = Addition(A=panel_61, B=panel_56, C=panel_62)
gate = StreamGate(Stream=addition_5, Gate=larger_2.OrEqualTo)  # -> Target0, Target1
addition_6 = Addition(A=panel_60, B=Slider(0.5, range=0..1))
# Everytime you increase +0.25 everytime you beat previous highest score + 0.25 etc
subtraction_10 = Subtraction(A=gate.Target1, B=addition_6)
lng_16 = ListLength(List=python.item)  # disabled
mod = Modulus(A=number_slider_9, B=lng_16)  # disabled
filter = StreamFilter(Gate=larger_2.OrEqualTo, Stream0=gate.Target0, Stream1=subtraction_10)
item_11 = ListItem(List=flatten(python.item), Index=mod, Wrap=True)  # disabled
item_12 = ListItem(List=list_of_dead_neighbours, Index=0, Wrap=True)  # disabled
concat = Concatenate(FragmentA=panel_34, FragmentB=mod, FragmentC=panel_33)  # disabled
panel_63 = Panel(addition_5)
item_13 = ListItem(List=flatten(pt), Index=item_12, Wrap=True)  # disabled
branch = TreeBranch(Tree=ni.A, Path=concat, MaintainPaths=True)  # disabled
branch_2 = TreeBranch(Tree=ni_2.A, Path=concat, MaintainPaths=True)  # disabled
cir_3 = Circle(Plane=item_13, Radius=number_slider_10)  # disabled
item_14 = ListItem(List=flatten(pt), Index=branch_2, Wrap=True)  # disabled
item_15 = ListItem(List=flatten(pt), Index=item_11, Wrap=True)  # disabled
item_16 = ListItem(List=flatten(pt), Index=branch, Wrap=True)  # disabled
panel_64 = Panel(python_10.a)
# Action_space
# 
# Turn each itteration to 1 or 2
python_11 = GhPythonScript(reset=agent.reset, observation=panel_64, reward=panel_63, done_inp=or_2)  # -> done_out; inputs observation: list
# ---------- python_11: Python ----------
"""Provides a scripting component.
    Inputs:
        x: The x script variable
        y: The y script variable
        max_len
    Output:
        a: The a output variable
        
    RETURN:
----------
    <out>
        done_out
    </out>

__author__ = "yuxi"
__version__ = "2021.06.12"""

import socket
import rhinoscriptsyntax as rs
import scriptcontext as sc



info = {"action_space": "gym.spaces.Discrete(2)",#agent will sent 6 actions(0,1,2,3,4,5)
    "observation_space": "gym.spaces.Box(low=0., high=1., shape=(10,))"} #this means that the observation is a list with 37 floats whose range from -2 to 2 


sc.sticky["observation"] = observation
sc.sticky["reward"] = reward
sc.sticky["done_inp"] = done_inp
sc.sticky["info"] = info if info is not None else {}


# Send Done Through
done_out = done_inp
# ---------- end python_11 ----------
item_17 = ListItem(List=flatten(pt), Index=python_4.neighbour_index, Wrap=True)
tag_3 = TextTag3D(Location=item_17, Text=python_4.neighbour_states, Size=Slider(5, range=0..10), Justification=7)

# ==== cluster Cluster_4
bool = ClusterInput()
cluster = Cluster(bool=bool)
panel = Panel("item index")
tstat = TreeStatistics(Tree=cluster)  # -> Paths, Length, Count
panel_2 = Panel("tree index")
cluster_2 = Cluster_2(bool=tstat.Length, x=tstat.Length)
data = Data(flatten(cluster_2))
data_2 = Data(flatten(cluster))
# finding index of green and res
cluster_3 = Cluster_3(tree_index=data, item_index=data_2)
item = ClusterOutput(cluster_3)
data_3 = ClusterOutput(data)
data_4 = ClusterOutput(data_2)

# ==== cluster Cluster_5
d1 = ClusterInput()
d2 = ClusterInput()
merge = Merge(Data1=d1, Data2=d2)  # -> flatten(Result)
sort = SortList(Keys=merge)  # -> Keys, ValuesA
K = ClusterOutput(sort.Keys)

# ==== cluster Cluster_6
points = ClusterInput()
points_2 = Data(points)
i = ClusterInput()
i_2 = ClusterInput()
item = ListItem(List=flatten(points_2), Index=i, Wrap=True)
item_2 = ListItem(List=flatten(points_2), Index=i_2, Wrap=True)
dist = Distance(PointA=item, PointB=graft(item_2))  # -> simplify(Distance)
sort = SortList(Keys=dist)  # -> simplify(Keys), ValuesA
item_3 = ListItem(List=sort.Keys, Index=0, Wrap=True)  # -> flatten(Item)
bnd = Bounds(Numbers=item_3)
dedomain = DeconstructDomain(Domain=bnd)  # -> Start, End
multiplication = Multiplication(A=dedomain.End, B=Slider(4, range=0..10))
dom = ConstructDomain(DomainStart=dedomain.Start, DomainEnd=multiplication)
remap = RemapNumbers(Value=item_3, Source=bnd, Target=dom)  # -> Mapped, Clipped
ma = MassAddition(Input=remap.Mapped)  # -> Result, PartialResults
lng = ListLength(List=item_3)
division = Division(A=ma.Result, B=lng)
R = ClusterOutput(division)

# ==== cluster Cluster_7
total_indices = ClusterInput()
total_indices_2 = Data(total_indices)
B = ClusterInput()
multiplication = Multiplication(A=total_indices_2, B=B)
subtraction = Subtraction(A=total_indices_2, B=multiplication)
int = Integer(subtraction)
int_2 = Integer(multiplication)
number_of_useable_green = Integer(int)
number_of_useable_residential = Integer(int_2)
number_of_useable_green_2 = ClusterOutput(number_of_useable_green)
python = GhPythonScript(x=number_of_useable_green, y=number_of_useable_residential, z=total_indices_2)  # -> out, a
# ---------- python: Python ----------
__author__ = "muham"
__version__ = "2023.05.02"

import rhinoscriptsyntax as rs


t_r = x + y

if t_r == z:
    a = y
elif t_r > 225:
    a = y-1
else:
    a = y+1
# ---------- end python ----------
a = ClusterOutput(python.a)

# ==== cluster Cluster_8
L = ClusterInput()
L_2 = ClusterInput()
ratio_chosen = ClusterInput()
B = ClusterInput()
lng = ListLength(List=L)
lng_2 = ListLength(List=L_2)
ratio_chosen_2 = ClusterOutput(ratio_chosen)
division = Division(A=lng, B=B)
division_2 = Division(A=lng_2, B=B)
R = ClusterOutput(division)
R_2 = ClusterOutput(division_2)

# ==== cluster Cluster
bool = ClusterInput()
toggle = BooleanToggle(True)
bool_2 = Boolean(bool)
equals = Equality(FirstNumber=bool_2, SecondNumber=toggle)  # -> Equality, Inequality
mindex = MemberIndex(Set=equals.Equality, Member=toggle)  # -> Index, Count
I = ClusterOutput(mindex.Index)

# ==== cluster Cluster_2
bool = ClusterInput()
x = ClusterInput()
cluster = Cluster(bool=bool)
python = GhPythonScript(x=x)  # -> out, graft(a); inputs x: list
# ---------- python: Python ----------
__author__ = "muham"
__version__ = "2023.04.24"

import rhinoscriptsyntax as rs

a = []
for i in x:
    if i != 0:
        a.append(i)
# ---------- end python ----------
data = Data(flatten(cluster))
repeat = RepeatData(Data=graft(data), Length=python.a)  # -> flatten(Data)
D = ClusterOutput(repeat)

# ==== cluster Cluster_3
item_index = ClusterInput()
tree_index = ClusterInput()
item_index_2 = Data(item_index)
tree_index_2 = Data(tree_index)
panel = Panel(item_index_2)
panel_2 = Panel(tree_index_2)
multiplication = Multiplication(A=panel_2, B=Slider(15, range=0..100))
addition = Addition(A=panel, B=multiplication)
panel_3 = Panel(addition)
item = Data(panel_3)
item_2 = ClusterOutput(item)
